# Grasshopper definition paramtyoes.gh (Grasshopper 1.0.7)
# plug-ins: paramtypes

line = Line(Line((-2.645600847, -23.13351519, 0), (-16.32995872, -23.13351519, 0)))
cmyk = ColourCMYK(Cyan=0, Magenta=0, Yellow=0, Key=0)
id = Guid("3fe737ff-2f96-4772-9ea3-2952337ec733")
arc = Arc(Plane=PlaneXY(0, 0, 0), Radius=1, Angle=Domain(0, 3.141592654))  # -> Arc, Length
panel = Panel("2")
matrix = ConstructMatrix(Rows="2", Columns="2", Values="1")
culture = Culture("German")
face = MeshFace()
box = Box({Plane=Plane(origin=(1, -5.040913113, 1), x=(0, 1, 0), y=(1, 0, 0)), X=Domain(0, 5.230421125), Y=Domain(0, 7.452057325), Z=Domain(-6.412879437, 0)})
fvector = VectorForce(Line=line, Bounds=box)
field = Field(fvector)
panel_2 = Panel(field)
circle = Circle({Plane=Plane(origin=(-1.441777477, -8.559597294, 0), x=(0.8836901284, -0.4680723843, 0), y=(0.4680723843, 0.8836901284, 0)), Radius=3.818939568})
brep = Brep(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)
line_2 = Line(Line((-20.39850002, -7.467185319, 0), (6.610520733, -28.5294339, 0)))
dom = ConstructDomain(DomainStart="0", DomainEnd="1")
mesh = Mesh(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)
crv = Curve(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)
complex = CreateComplex(Real=0, Imaginary=0)
path = FilePath("C:\")
geo = Geometry(brep)
group = Group(Objects=geo)
grp = Group(group)
matrix_2 = Matrix(matrix)
params = ParamTypes(
    Arc=arc.Arc,
    Boolean=Toggle(False),
    Box=box,
    Brep=brep,
    Circle=circle,
    Colour=cmyk,
    Complex=complex,
    Culture=culture,
    Curve=crv,
    Filepath=path,
    Geometry=geo,
    Group=grp,
    Integer="1",
    Interval=dom,
    Interval2d=dom,
    Latlonlocation="47, 8",
    Line=line_2,
    Matrix=matrix_2,
    Mesh=mesh)  # -> Arc, Boolean, Box, Brep, Circle, Colour, Complex, Culture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
panel_3 = Panel([params.Arc, params.Boolean, params.Box, params.Brep, params.Circle, params.Colour, params.Complex, params.Culture, params.Curve, params.Field, params.Filepath, params.Generic, params.Geometry, params.Group, params.Guid, params.Integer, params.Interval, params.Interval2d, params.Latlonlocation, params.Line, params.Matrix, params.Mesh, params.Meshface, params.Meshparameters, params.Float, params.Oglshader, params.Plane, params.Point, params.Rectangle, params.Scriptvariable, params.String, params.Structurepath, params.Surface, params.Time, params.Transform, params.Vector])
